% Simulink data dictionary ASW.sldd
% references ThermalMon.sldd
% references ThermalRct.sldd

ThermalState_e = enum()
  THERM_UNDER_TEMP = 0
  THERM_NORMAL = 1
  THERM_WARNING = 2
  THERM_OVERHEAT = 3
  THERM_CRITICAL = 4

ContactorCmd_e = enum()
  CONTACTOR_OPEN = 0
  CONTACTOR_CLOSE = 1

BatteryThermalCmd_t = Simulink.Bus()
  bCoolingFanCmd: boolean  % Command to enable or disable the cooling fan
  bBatteryHeaterCmd: boolean  % Command to activate battery heating system
  bFaultLatch: boolean  % Latched thermal fault requiring system reset
  uPumpSpeedCmd: uint16  % Requested cooling pump speed percentage
  eBatteryContactorCmd: Enum: ContactorCmd_e  % Command to open or close the battery contactor
  fChargeCurrentLimit: single  % Maximum allowed battery charging current
  fDischargeCurrentLimit: single  % Maximum allowed battery discharging current

BatteryThermalStatus_t = Simulink.Bus()
  eThermalState: Enum: ThermalState_e  % Classified thermal state of the battery pack
  fFilteredTemp: single  % Filtered and stabilized battery temperature value
  fTempGradient: single  % Rate of temperature change over time (°C/s)
  bOverTempWarn: boolean  % Indicates battery temperature exceeds warning threshold
  bOverTempCrit: boolean  % Indicates battery temperature exceeds critical threshold
  bDerateReq: boolean  % Request to reduce charging and discharging power
  bUnderTemp: boolean  % Indicates battery temperature is below minimum operating limit

BatteryThermalInput_t = Simulink.Bus()
  fCellTempMax: single  % Maximum temperature measured among all battery cells
  fCellTempMin: single  % Minimum temperature measured among all battery cells
  fPackTemp: single  % Average temperature of the battery pack
  fChargeCurrent: single  % Current flowing into the battery during charging
  fAmbientTemp: single  % Ambient environmental temperature surrounding the battery
  bSensorValid: boolean  % Indicates whether thermal sensor data is valid
  fDischargeCurrent: single  % Current flowing out of the battery during discharging

BatteryThermalAdc_t = Simulink.Bus()
  uAmbientTempAdc: uint16  % ADC measurement of ambient environmental temperature surrounding the battery
  uCellTempMaxAdc: uint16  % ADC measurement of mamaximum temperature measured among all battery cells
  uCellTempMinAdc: uint16  % ADC measurement of minimum temperature measured among all battery cells
  uPackTempAdc: uint16  % ADC measurement of average temperature of the battery pack